vi "IndoorMonitoring.gviweb"   [LabVIEW NXG 3.0.0]
panel controls:
  "Tab": i32
  "Node 1 Files": i32 = -1
  "Node 2 Files": i32 = -1
panel indicators:
  "Node 1 Temp": f64
  "Node 1 RH": f64
  "Node 2 Temp": f64
  "Node 2 RH": f64
  "Node 1": string
  "Node 2": string
  "status": bool
  "AVG_Plot": cluster{"Element 1": f64[], "Element 2": f64[]}[]
  "Update Time": string
  "Hist1": cluster{"Element 1": f64[], "Element 2": f64[]}[]
  "HistMinMax": cluster{"Element 1": f64[], "Element 2": f64[]}[]
  "HistMinMax_2": cluster{"Element 1": f64[], "Element 2": f64[]}[]
  "AVG_Plot_2": cluster{"Element 1": f64[], "Element 2": f64[]}[]
  "HistMinMax_3": cluster{"Element 1": f64[], "Element 2": f64[]}[]
  "HistMinMax_4": cluster{"Element 1": f64[], "Element 2": f64[]}[]
  "Hist1_2": cluster{"Element 1": f64[], "Element 2": f64[]}[]
uses:
  NI::HTTP::Open HTTP Handle.gvi
  WebApp::UI_Actuals.gvi
  WebApp::UI_Averaged.gvi
  WebApp::NodeCommunication::GetFileList.gvi
  WebApp::UI_HistoricalMinMax.gvi
  WebApp::UI_Historical.gvi
diagram:
  Property Node(instance in=reference to "Tab", "Value"=0) -> (instance out=w1)
  for {
    w2 = each element of ["192.168.178.67", "192.168.178.144"]
    Format Into String(formatString="http://%s:8002/IndoorMonitoring/", w2) -> w4
    append w4 to w3
  }
  Build Array(reference to "Node 1 Files", reference to "Node 2 Files") -> w5
  call "Open HTTP Handle.gvi"() -> (client handle out=w6)
  s1 = w3  # shift register
  s2 = w6  # shift register
  s3 = 10  # shift register
  while (after w1) {
    w7 = $Tab
    event (timeout = s3) (after w7) {
      on Timeout {
        Get Date And Time String(want seconds? (F)=TRUE) -> (time string=w12)
        $"Update Time" <- w12
        call "UI_Actuals.gvi"(Input=s2, Base URL=s1) -> (Output=w13, Debug=w14, Actuals=w15, Error out=w16)
        call "UI_Averaged.gvi"(Input=w13, Base URL=s1, Error=w16) -> (Output=w9, Graphs 1=w17, Graphs 2=w18, Error out=w10)
        $AVG_Plot <- w17
        Array Index(array=w14) -> (out0[_]=w19, out1[_]=w20)
        $"Node 1" <- w19
        $AVG_Plot_2 <- w18
        $"Node 2" <- w20
        Array Index(array=w15) -> (out0[_]=w21, out1[_]=w22)
        Property Node(instance in=w21) -> ("Temp"=w23, "RH"=w24)
        $"Node 1 Temp" <- w23
        $"Node 1 RH" <- w24
        Property Node(instance in=w22) -> ("Temp"=w25, "RH"=w26)
        $"Node 2 Temp" <- w25
        $"Node 2 RH" <- w26
        w8 = s1
        w11 = 15000
      }
      on "Tab" Value changed {
        Event Data() -> ("New Value"=w27)
        case (w27) {
          frame 0, Default {
            w8 = s1
            w9 = s2
            w10 = default
          }
          frame 1 {
            s4 = s2  # shift register
            for {
              w28 = each element of s1
              w29 = each element of w5
              call "GetFileList.gvi"(client handle=s4, BaseURL=w28) -> (client handle out=w30, value=w31, error out=w10)
              Property Node(instance in=w29, "Items"=w31, "Value"=0)
              next s4 = w30
            }
            w8 = s1
            w9 = s4
          }
          frame 2, 3 {
            call "UI_HistoricalMinMax.gvi"(Input=s2, Base URL=s1) -> (Output=w9, GraphsT=w32, GraphsRH=w33, Error out=w10)
            Delete From Array(inArray=w32, length (1)=2) -> (outArray=w34, deleted=w35)
            $HistMinMax <- w34
            $HistMinMax_3 <- w35
            Delete From Array(inArray=w33, length (1)=2) -> (outArray=w36, deleted=w37)
            $HistMinMax_2 <- w36
            $HistMinMax_4 <- w37
            w8 = s1
          }
        }
        w11 = s3
      }
      on "Node 1 Files" Value changed; "Node 2 Files" Value changed {
        for {
          w38 = each element of w5
          Property Node(instance in=w38) -> ("Items"=w40, "Value"=w41)
          Array Index(array=w40) -> (out0[w41]=w42)
          append w42 to w39
        }
        call "UI_Historical.gvi"(Input=s2, Base URL=s1, Filenames=w39) -> (Output=w9, Graphs=w43, Graphs_2=w44, Error out=w10)
        $Hist1 <- w43
        $Hist1_2 <- w44
        w8 = s1
        w11 = s3
      }
    }
    Property Node(instance in=w10) -> ("status"=w45)
    $status <- w45
    next s1 = w8
    next s2 = w9
    next s3 = w11
    stop if FALSE
  }
