vi "UI_HistoricalMinMax.gvi"   [LabVIEW NXG 3.0.0]
inputs:
  "Input": "Client Handle.gtype"
  "Error": error
  "Base URL": string[]
outputs:
  "Output": "Client Handle.gtype"
  "Error out": error
  "GraphsT": cluster{"Element 1": f64[], "Element 2": f64[]}[]
  "GraphsRH": cluster{"Element 1": f64[], "Element 2": f64[]}[]
types:
  "Client Handle.gtype" = u32
uses:
  WebApp::NodeCommunication::GetHistoricalMinMax.gvi
diagram:
  case ($Error) {
    frame Error, Default {
      w1 = $Input
      w2 = $Error
      w3 = default
      w4 = default
    }
    frame No Error {
      s1 = $Input  # shift register
      s2 = $Error  # shift register
      for {
        w5 = each element of $"Base URL"
        call "GetHistoricalMinMax.gvi"(client handle=s1, BaseURL=w5, Error in=s2) -> (client handle out=w6, HistMinMax=w7, error out=w8)
        Property Node(instance in=w7) -> ("Time"=w9, "Temp Max"=w10, "Temp Min"=w11, "RH Max"=w12, "RH Min"=w13)
        Build Cluster(w9, w10) -> w14
        Build Cluster(w9, w11) -> w15
        Build Array(w14, w15) -> w16
        Build Cluster(w9, w12) -> w17
        Build Cluster(w9, w13) -> w18
        Build Array(w17, w18) -> w19
        concatenate w16 onto w3
        concatenate w19 onto w4
        next s1 = w6
        next s2 = w8
      }
      w1 = s1
      w2 = s2
    }
  }
  $GraphsT <- w3
  $GraphsRH <- w4
  $Output <- w1
  $"Error out" <- w2
